# Grasshopper definition a2_cecarrol.gh (Grasshopper 0.9.80)

# ---- group: RECT / create RECT
rectangle_width = Slider(2, range=0..10)
rectangle_height = Slider(4, range=0..10)
rectangle = Rectangle(Plane=PlaneXY(0, 0, 0), XSize=rectangle_width, YSize=rectangle_height, Radius=0)  # -> Rectangle, Length

# ---- group: create TAB / TAB
tab_width = Slider(0.591, range=0..10)
tab_height = Slider(0.375, range=0..10)
tab = Rectangle(Plane=PlaneXY(0, 0, 0), XSize=tab_width, YSize=tab_height, Radius=0)  # -> Rectangle, Length

# ---- group: create TAB / place tab
half = Division(RECTWidth=rectangle_width, B=2)
half_2 = Division(TABWidth=tab_width, B=2)
subtraction = Subtraction(A=half, B=half_2)
vector_xyz = VectorXYZ(XComponent=subtraction, YComponent=rectangle_height, ZComponent=0)  # -> Vector, Length
move = Move(Geometry=tab.Rectangle, Motion=vector_xyz.Vector)  # -> Geometry, Transform

# ---- group: SCORES / create SCORE
addition = Addition(A=rectangle_width, B=0.1)
construct_point = ConstructPoint(XRECTWidth01=addition, YCoordinate=0, ZCoordinate=0)
construct_point_2 = ConstructPoint(XCoordinate=-0.1, YCoordinate=0, ZCoordinate=0)
score = Line(StartPoint=construct_point_2, EndPoint=construct_point)

# ---- group: SCORES / score array
score_height = Slider(0.25, range=0..1)
score_vector = VectorXYZ(XComponent=0, YComponent=score_height, ZComponent=0)  # -> Vector, Length
division = Division(RECTHeight=rectangle_height, SCOREHeight=score_height)
addition_2 = Addition(A=division, B=1)
linear_array = LinearArray(Geometry=score, Direction=score_vector.Vector, Count=addition_2)  # -> Geometry, Transform

# ---- group: SLOTS / create SLOT
tab_width_tolerance = Slider(0.005, range=0..1)
cardboard_width = Slider(0.151, range=0..1)
subtraction_2 = Subtraction(TABWidth=tab_width, TabWidthTolerance=tab_width_tolerance)
slot_height = Number(cardboard_width)
slot = Rectangle(Plane=PlaneXY(0, 0, 0), XSize=subtraction_2, YSize=slot_height, Radius=0)  # -> Rectangle, Length

# ---- group: SLOTS / place slot
half_3 = Division(A=score_height, B=2)
half_4 = Division(A=slot_height, B=2)
half_5 = Division(A=subtraction_2, B=2)
subtraction_3 = Subtraction(A=half_3, B=half_4)
subtraction_4 = Subtraction(A=half, B=half_5)
vector_xyz_2 = VectorXYZ(XComponent=subtraction_4, YComponent=subtraction_3, ZComponent=0)  # -> Vector, Length
move_2 = Move(Geometry=slot.Rectangle, Motion=vector_xyz_2.Vector)  # -> Geometry, Transform

# ---- group: SLOTS / slot array
linear_array_2 = LinearArray(Geometry=move_2.Geometry, Direction=score_vector.Vector, Count=Slider(5, range=0..16))  # -> Geometry, Transform

# ---- group: KIT SHAPE 1 (RECTANGLE) / create KIT SHAPE 1
group = Group(Objects=[move.Geometry, linear_array_2.Geometry, rectangle.Rectangle])

# ---- group: CIRCLE / create CIRCLE
circle_radius = Slider(0.75, range=0..3)
circle = Circle(Plane=PlaneXY(0, 0, 0), Radius=circle_radius)

# ---- group: SLOT 2 / create SLOT 2
circle_slot_tolerance = Slider(0.005, range=0..0.01)
subtraction_5 = Subtraction(SlotHeight=slot_height, SlotTolerance=circle_slot_tolerance)
rectangle_2 = Rectangle(Plane=PlaneXY(0, 0, 0), XSize=subtraction_2, YSize=subtraction_5, Radius=0)  # -> Rectangle, Length

# ---- group: SLOT 2 / place SLOT 2
negative_half = Division(CircleSlotHeight=subtraction_5, _2=-2)
subtraction_6 = Subtraction(CircleRadius=circle_radius, SlotWidth=subtraction_2)
vector_xyz_3 = VectorXYZ(XComponent=subtraction_6, YComponent=negative_half, ZComponent=0)  # -> Vector, Length
move_3 = Move(Geometry=rectangle_2.Rectangle, Motion=vector_xyz_3.Vector)  # -> Geometry, Transform

# ---- group: SLOT 2 / SLOT 2 array
polar_array = PolarArray(Geometry=move_3.Geometry, Plane=PlaneXY(0, 0, 0), Count4=4, Angle90=6.283185307)  # -> Geometry, Transform

# ---- group: KIT SHAPES 2 (CIRCLE) / create KIT SHAPE 2
group_2 = Group(Objects=[polar_array.Geometry, circle])

# ---- group: KIT SHAPES 2 (CIRCLE) / place KIT SHAPE 2
addition_3 = Addition(A=rectangle_height, B=2)
vector_xyz_4 = VectorXYZ(XCIRCLERadius=circle_radius, RECTHeight2=addition_3, ZComponent=0)  # -> Vector, Length
move_4 = Move(Geometry=group_2, Motion=vector_xyz_4.Vector)  # -> KITSHAPE2, Transform

# ---- group: BAKE THESE!
kit_shape_2_circle = Geometry(move_4.KITSHAPE2)
kit_scores = Geometry(linear_array.Geometry)
kit_shape_1_rectangle = Geometry(group)
